test file "Basic_functions"

suite "Basic functionalities"

  case "CASE 1" [baseline]
    model add, harness add_Harness1
    parameter set "Parameter Set 1": A = 8, B = 2  % model workspace
    logged signals "Signal Set 1": C
    custom criteria:
      C = getTestLogsout('C',test);

      verifyTrue(test,all(C == 10),sprintf("The sum is 10"))
    iterations:
      Iteration3 (disabled): ParameterSet "Parameter Set 1"